test file "Sensor_Fusion_ZP"

suite "Sensor_Fusion_ZP/SF_GenerateNewResult"

  case "Sensor_Fusion_ZP_Harness1" [baseline]
    description: Test generated for the component 'Sensor_Fusion_ZP/SF_GenerateNewResult'.
    model Sensor_Fusion_ZP, harness Sensor_Fusion_ZP_Harness1 (for Sensor_Fusion_ZP/SF_GenerateNewResult)

suite "Sensor_Fusion_ZP/SF_GetResult"

  case "Sensor_Fusion_ZP_Harness2" [baseline]
    description: Test generated for the component 'Sensor_Fusion_ZP/SF_GetResult'.
    model Sensor_Fusion_ZP, harness Sensor_Fusion_ZP_Harness2 (for Sensor_Fusion_ZP/SF_GetResult)

suite "Sensor_Fusion_ZP/SF_Init"

  case "Sensor_Fusion_ZP_Harness3" [baseline]
    description: Test generated for the component 'Sensor_Fusion_ZP/SF_Init'.
    model Sensor_Fusion_ZP, harness Sensor_Fusion_ZP_Harness3 (for Sensor_Fusion_ZP/SF_Init)