% Simulink data dictionary Sensor_Fusion_ZP.sldd

SensorErrorCodes_e = enum(DataScope="Imported", HeaderFile="common_data_types.hpp", DefaultValue="SENSOR_SUCCESS")
  SENSOR_SUCCESS = 0
  SENSOR_FAIL = 1

SFIterationData_t = Simulink.Bus(DataScope="Imported", HeaderFile="sensor_fusion.hpp")
  prevX: single[6]
  prevP: single[36]

SFError_t = Simulink.Bus(DataScope="Imported", HeaderFile="sensor_fusion.hpp")
  errorCode: int32

SFOutput_t = Simulink.Bus(DataScope="Imported", HeaderFile="sensor_fusion.hpp")
  roll: single
  pitch: single
  yaw: single
  rollRate: single
  pitchRate: single
  yawRate: single
  airspeed: single
  altitude: single
  rateOfClimb: single
  latitude: single
  latitudeSpeed: single
  longitude: single
  longitudeSpeed: single
  track: single
  heading: single

IMU_Data_t = Simulink.Bus(DataScope="Imported", HeaderFile="sensor_fusion.hpp")
  magx: single
  magy: single
  magz: single
  accx: single
  accy: single
  accz: single
  gyrx: single
  gyry: single
  gyrz: single
  temp: single
  isDataNew: boolean
  sensorStatus: Enum: SensorErrorCodes_e
  utcTime: single

Airspeed_Data_t = Simulink.Bus(DataScope="Imported", HeaderFile="sensor_fusion.hpp")
  airspeed: double
  sensorStatus: Enum: SensorErrorCodes_e
  isDataNew: boolean
  utcTime: single

Gps_Data_t = Simulink.Bus(DataScope="Imported", HeaderFile="sensor_fusion.hpp")
  latitude: single
  longitude: single
  utcTime: single
  groundSpeed: single
  altitude: int32
  heading: int32
  numSatellites: int32
  fixStatus: int32
  sensorStatus: Enum: SensorErrorCodes_e
  dataIsNew: boolean
  timeIsNew: boolean
  ggaDataIsNew: boolean
  vtgDataIsNew: boolean

Altimeter_Data_t = Simulink.Bus(DataScope="Imported", HeaderFile="sensor_fusion.hpp")
  pressure: single
  altitude: single
  temp: single
  isDataNew: boolean
  status: Enum: SensorErrorCodes_e
  utcTime: int32